# Grasshopper definition Structural_mapper.gh (Grasshopper 1.0.7)
# plug-ins: Karamba3D

pt = Point("0,1,0")
pt_2 = Point("5,1,0")
pt_3 = Point("10,1,0")
ln = Line(StartPoint=pt, EndPoint=pt_2)
ln_2 = Line(StartPoint=pt_2, EndPoint=pt_3)
merge = Merge(Data1=ln, Data2=ln_2)
Z = UnitZ(Factor="-1")
Z_2 = UnitZ(Factor="-1")
supp = SupportKaramba3D(PosInd=pt, menu=[buttons(on, on, on, on, off, off)])
supp_2 = SupportKaramba3D(PosInd=pt_3, menu=[buttons(off, on, on, off, off, off)])
loads = LoadsKaramba3D(ForceVector=Z_2, Local=False, PosInd=pt_2, LCase="1", mode="Point")
beam_loads = BeamLoadsKaramba3D(LoadCase="0", ForceVector=Z, TStart=0, TEnd=1, mode="Block", menu=[buttons(on, off, off)])
linetobeam = LineToBeamKaramba3D(
    Line=merge,
    New=True,
    Remove=True,
    LimitDistance_m=0.005,
    Bending=True,
    SetBucklingLength=True,
    ToPolylineMaxAngle=0.03,
    ToPolylineTolerance=0.01,
    ToPolylineMinEdgeLength=0.25)  # -> Element, Points, Info
load = LoadKaramba(flatten([loads, beam_loads]))
support = SupportKaramba([supp, supp_2])
assemble = AssembleModelKaramba3D(Elem=linetobeam.Element, Support=support, Load=load, LimitDistance_m=0.005)  # -> Model, Info, Mass_kg, CenterOfGravity, LoadCaseNames
analyzethi = AnalyzeKaramba3D(Model=assemble.Model)  # -> CalculatedModel, MaximumDisplacement_cm, ResultingForceOfGravity_kN, ElasticEnergy_kNm
modelview = ModelViewKaramba3D(Model=analyzethi.CalculatedModel, ResultFactors=1, ResultCase=-1)  # -> Model, DeformedMesh, DeformedAxes, DeformedModel
beamview = BeamViewKaramba3D(Model=modelview.Model)  # -> Model, MeshesOfRenderedBeams, DeformedBeamAxes, LegendColors, LegendTags
utilization = UtilizationOfElementsKaramba3D(
    AnalyzedModel=beamview.Model,
    NumberOfSamplePoints=3,
    ElasticDesign=True,
    GammaM0=1,
    GammaM1=1.1,
    SwayFrame=True,
    WithDetails=False,
    mode="Beams")  # -> AnalyzedModel, Utilization, SigMax_kN_cm2, SigMin_kN_cm2, TauMax_kN_cm2, UtilN, UtilVy, UtilVz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
num = Number(utilization.Utilization)
num_2 = Number([1.440260972, 1.440260972])
panel = Panel(num_2)
panel_2 = Panel(num)
similar = CSharpScript(x=num, y=num_2)  # -> out; inputs x: Double, y: Double
# ---------- similar: C# ----------
    if (Math.Abs(x - y) > 1E-10) throw new Exception ("The values x and y are not equal.");
# ---------- end similar ----------

crosecrselect = CrossSectionRangeSelectorKaramba(MaximumHeight_cm=-1, MaximumWidth_cm=-1, menu=[dropdown(1), dropdown(1), dropdown(1)])
Z_3 = UnitZ(Factor=1)
pt_4 = Point("0,0,0")
crosecselect = CrossSectionSelectorKaramba(CrossSections=crosecrselect, NameOrListIndexOfCrossSection="IPE300")  # -> CrossSection, Info
line = LineSDL(Start=pt_4, Direction=Z_3, Length="3")
Z_4 = UnitZ(Factor="-500")
supp_3 = SupportKaramba3D(PosInd="0", menu=[buttons(on, on, on, off, off, on)])
supp_4 = SupportKaramba3D(PosInd="1", menu=[buttons(on, on, off, off, off, off)])
loads_2 = LoadsKaramba3D(ForceVector=Z_4, Local=False, PosInd="1", LCase="0", mode="Point")
linetobeam_2 = LineToBeamKaramba3D(
    Line=line,
    CrossSection=crosecselect.CrossSection,
    New=True,
    Remove=True,
    LimitDistance_m=0.005,
    Bending=True,
    SetBucklingLength=True,
    ToPolylineMaxAngle=0.03,
    ToPolylineTolerance=0.01,
    ToPolylineMinEdgeLength=0.25)  # -> Element, Points, Info
support_2 = SupportKaramba([supp_3, supp_4])
assemble_2 = AssembleModelKaramba3D(Elem=linetobeam_2.Element, Support=support_2, Load=loads_2, LimitDistance_m=0.005)  # -> Model, Info, Mass_kg, CenterOfGravity, LoadCaseNames
analyzethii = AnalyzeThIIKaramba3D(Model=assemble_2.Model, RTolerance=1e-07, MaxIterations=50, NoTensionalNII=False)  # -> CalculatedModel, MaximumDisplacement_cm, ResultingForceOfGravity_kN, ElasticEnergy_kNm
modelview_2 = ModelViewKaramba3D(Model=analyzethii.CalculatedModel, ResultFactors=1, ResultCase=-1)  # -> Model, DeformedMesh, DeformedAxes, DeformedModel
utilization_2 = UtilizationOfElementsKaramba3D(
    AnalyzedModel=modelview_2.Model,
    NumberOfSamplePoints=3,
    ElasticDesign=True,
    GammaM0=1,
    GammaM1="1",
    SwayFrame=True,
    WithDetails=Toggle(True),
    mode="Beams")  # -> AnalyzedModel, Utilization, SigMax_kN_cm2, SigMin_kN_cm2, TauMax_kN_cm2, UtilN, UtilVy, UtilVz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
beamview_2 = BeamViewKaramba3D(Model=modelview_2.Model)  # -> Model, MeshesOfRenderedBeams, DeformedBeamAxes, LegendColors, LegendTags
panel_3 = Panel(utilization_2.Utilization)
panel_4 = Panel(utilization_2.Details)
legend = Legend(Colour=beamview_2.LegendColors, Tags=beamview_2.LegendTags, LegendType=1)

# ----
# A tower with horizontal loads and variable diameter along its height is optimized for minimum deflection using Galapagos.
# create axis
# geometry
# convert axis
# to beams
# assemble
# analyze
# view
# supports
# loads
# define cross section
slider = Slider(14.2, range=5..15)
range = Range(Domain=Domain(0, 6.283185307), Steps=16)
range_2 = Range(Domain=Domain(0, 25), Steps=7)
pt_5 = PointCylindrical(
    BasePlane=PlaneXY(0, 0, 0),
    Angle=graft(range),
    Radius=["12", Slider(13.2, range=5..15), Slider(11.7, range=5..15), Slider(11, range=5..15), slider, Slider(14.8, range=5..15), Slider(12.2, range=5..15), Slider(5.8, range=5..15)],
    Elevation=range_2)  # -> simplify(Point)
galapagos = Galapagos()
item = ListItem(List=pt_5, Index=0, Wrap=True)  # -> flatten(Item)
flip = FlipMatrix(Data=pt_5)
series = Series(Start=0, Step=1, Count=8)
shift = ShiftList(List=flip, Shift=expr("-x", graft(series)), Wrap=True)  # -> simplify(List)
shift_2 = ShiftList(List=flip, Shift=graft(series), Wrap=True)  # -> simplify(List)
cull_i = CullIndex(List=pt_5, Indices=0, Wrap=False)
flip_2 = FlipMatrix(Data=cull_i)
flip_3 = FlipMatrix(Data=shift_2)
flip_4 = FlipMatrix(Data=shift)
pline = PolyLine(Vertices=flip_2, Closed=False)
pline_2 = PolyLine(Vertices=pt_5, Closed=False)
pline_3 = PolyLine(Vertices=flip_3, Closed=False)
pline_4 = PolyLine(Vertices=flip_4, Closed=False)
rdpoints = RemoveDuplicatePointsKaramba(Point=item, LimitDistance=0.005)  # -> OutPoint, Info, Indexes
explode = Explode(Curve=[pline, pline_2, pline_3, pline_4], Recursive=True)  # -> flatten(Segments), Vertices
supp_5 = SupportKaramba3D(PosInd=rdpoints.OutPoint, menu=[buttons(on, on, on, off, off, off)])
loads_3 = LoadsKaramba3D(ForceVector="100,0,0", Local=False, PosInd=flatten(pt_5), LCase="0", mode="Point")
cross_section = CrossSectionKaramba3D(
    FamilyNameOfCrossSection="DefaultCroSec",
    Material=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,
    Diameter_cm=Slider(16.1, range=0.1..30),
    WallThickness_cm=Slider(0.2, range=0.1..3),
    mode="Circular Hollow")
linetobeam_3 = LineToBeamKaramba3D(
    Line=explode.Segments,
    New=True,
    Remove=True,
    LimitDistance_m=0.005,
    Bending=True,
    SetBucklingLength=True,
    ToPolylineMaxAngle=0.03,
    ToPolylineTolerance=0.01,
    ToPolylineMinEdgeLength=0.25)  # -> Element, Points, Info
assemble_3 = AssembleModelKaramba3D(Elem=linetobeam_3.Element, Support=supp_5, Load=loads_3, CrossSection=cross_section, LimitDistance_m=0.005)  # -> Model, Info, Mass_kg, CenterOfGravity, LoadCaseNames
analyzethi_2 = AnalyzeKaramba3D(Model=assemble_3.Model)  # -> CalculatedModel, MaximumDisplacement_cm, ResultingForceOfGravity_kN, ElasticEnergy_kNm
num_3 = Number(analyzethi_2.MaximumDisplacement_cm)
modelview_3 = ModelViewKaramba3D(Model=analyzethi_2.CalculatedModel, ResultFactors=1, ResultCase=-1)  # -> Model, DeformedMesh, DeformedAxes, DeformedModel
beamview_3 = BeamViewKaramba3D(Model=modelview_3.Model)  # -> Model, MeshesOfRenderedBeams, DeformedBeamAxes, LegendColors, LegendTags

# ----
# Structural calcs
disassemble = DisassembleModelKaramba3D()  # -> Model, Point, Beam, Shell, Support, Load, Line, Mesh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

# ---- group: Generate random set
# "Supply" bank
number_slider = Slider(100, range=0..1000)
dom = ConstructDomain(DomainStart=0, DomainEnd=1)
random = Random(Range=Domain(0, 1), Number=number_slider, Seed=5)
random_2 = Random(Range=dom, Number=number_slider, Seed=2)
random_3 = Random(Range=dom, Number=number_slider, Seed=2)
graph = GraphMapper(random_2, x0=0, x1=1, y0=0, y1=1, container_name="Gaussian", factor=0.3311616182, mean=0.3070082068, sdev=0.3750673234)
graph_2 = GraphMapper(random_3, x0=0, x1=1, y0=0, y1=1, container_name="Gaussian", factor=0.5366398096, mean=0.5903694034, sdev=0.3804182708)
graph_3 = GraphMapper(random, x0=0, x1=1, y0=0, y1=1, container_name="Gaussian", factor=0.7170143127, mean=0.3882903457, sdev=0.2943618894)
multiplication = Multiplication(A=graph_3, B="10000")
multiplication_2 = Multiplication(A=graph_2, B="500")
multiplication_3 = Multiplication(A=graph, B="500")
round = Round(Number=multiplication_2)  # -> Nearest, Floor, Ceiling
round_2 = Round(Number=multiplication_3)  # -> Nearest, Floor, Ceiling
pt_6 = ConstructPoint(XCoordinate=round.Nearest, YCoordinate=0, ZCoordinate=0)
pt_7 = ConstructPoint(XCoordinate=0, YCoordinate=round_2.Nearest, ZCoordinate=0)
rec_2pt = Rectangle2Pt(Plane=PlaneXY(0, 0, 0), PointA=pt_6, PointB=pt_7, Radius=0)  # -> Rectangle, Length
panel_5 = Panel(rec_2pt.Rectangle)
boxrec = BoxRectangle(Rectangle=rec_2pt.Rectangle, Height=multiplication)
geo = Geometry(boxrec)

# ----
# "Demand" structure
pipeline = GeometryPipeline(
    GroupByLayer=False,
    GroupByType=False,
    IncludeHidden=False,
    IncludeLocked=True,
    LayerFilter="*",
    NameFilter="*",
    SublayerFiltering=True,
    TypeFilter=1073741848)
geo_2022_08_01 = Geometry([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])
geo_2 = Geometry(pipeline)
geo_3 = Geometry([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])

# ----
# TODO: make groups of similar profiles
panel_6 = Panel("TODO: add circular")

# ---- group: Distibute in circle
# Rearrange for better view
geo_4 = Geometry(geo)
geo_5 = Geometry(geo_3)
bbox = BoundingBox(Content=geo_5, Plane=PlaneXY(0, 0, 0), UnionBox=True)  # -> Box, Box_2
box = EvaluateBox(Box=geo_4, UParameter=0.5, VParameter=0.5, WParameter=0)  # -> Plane, Point, Include
box_2 = EvaluateBox(Box=geo_4, UParameter=0.5, VParameter=0.5, WParameter=1)  # -> Plane, Point, Include
lng = ListLength(List=geo_4)
box_3 = EvaluateBox(Box=bbox.Box, UParameter=0, VParameter=0, WParameter=0)  # -> Plane, Point, Include
box_4 = EvaluateBox(Box=bbox.Box, UParameter=0.5, VParameter=0.5, WParameter=0)  # -> Plane, Point, Include
dist = Distance(PointA=box.Point, PointB=box_2.Point)
dist_2 = Distance(PointA=box_4.Point, PointB=box_3.Point)
sort = SortList(Keys=dist, ValuesA=box.Point)  # -> Keys, ValuesA
pl = PlaneNormal(Origin=Point(0, 0, 0), ZAxis=Vector(0, 0, 1))
sort_2 = SortList(Keys=dist, ValuesA=geo_4)  # -> Keys, ValuesA
addition = Addition(A=Slider(3863, range=0..10000), B=dist_2)
orient = Orient(Geometry=sort_2.ValuesA, Source=pl, Target=PlaneXY(0, 0, 0))  # -> Geometry, Transform
circle = CircleCNR(Center=box_4.Plane, Normal=Vector(0, 0, 1), Radius=addition)
divide = DivideCurve(Curve=circle, Count=lng, Kinks=False)  # -> Points, Tangents, Parameters
vec2pt = Vector2Pt(PointA=sort.ValuesA, PointB=divide.Points, Unitize=False)  # -> Vector, Length
move = Move(Geometry=orient.Geometry, Motion=vec2pt.Vector)  # -> Geometry, Transform
geo_6 = Geometry(move.Geometry)

# ----
# Input
# processing
geo_7 = Geometry(geo_3)
geo_8 = Geometry(geo_6)
cluster = Cluster_2(geo=geo_7)  # -> profile_srf_2, center_line_2, profile_boundary_crv_2, geometry_bbox_2, centroid, box_volume
cluster_2 = Cluster_2(geo=geo_8)  # -> profile_srf_2, center_line_2, profile_boundary_crv_2, geometry_bbox_2, centroid, box_volume
area = Area(Geometry=cluster.profile_srf_2)  # -> Area, Centroid
area_2 = Area(Geometry=cluster_2.profile_srf_2)  # -> Area, Centroid

srf = Surface(cluster.profile_srf_2)

# ----
# Mapping using closest points
profile_srf = Surface(cluster.profile_srf_2)
line_2 = Line(cluster.center_line_2)
profile_srf_2 = Surface(cluster_2.profile_srf_2)
line_3 = Line(cluster_2.center_line_2)
merge_2 = Merge(Data1=profile_srf, Data2=profile_srf_2)
merge_3 = Merge(Data1=line_2, Data2=line_3)
lng_2 = ListLength(List=profile_srf)
# TODO: add more parameters for grouping: LCA/transport, Length?
len = Length(Curve=merge_3)
amoments = AreaMoments(Geometry=merge_2)  # -> Area, Centroid, Inertia, InertiaError, Secondary, SecondaryError, Gyration
cluster_3 = Cluster(init_numbers=amoments.Area, target_max="1000")
cluster_4 = Cluster(init_numbers=amoments.Inertia, target_max="1000")
cluster_5 = Cluster(init_numbers=len, target_max="1000")
entwine = Entwine(Branch00=cluster_3, Branch01=cluster_4, Branch02=cluster_5, FlattenInputs=True)
flip_5 = FlipMatrix(Data=entwine)
num2pt = NumbersToPoints(Numbers=flip_5, Mask=4)  # -> flatten(Points)
split = SplitList(List=num2pt, Index=lng_2)  # -> ListA, ListB
pt_8 = Point(split.ListA)
pt_9 = Point(split.ListB)

# ---- group: Format inputs
geo_9 = Geometry(geo_7)
area_3 = Number(area.Area)
# Mapping using Python
line_4 = Line(cluster.center_line_2)
len_2 = Length(Curve=line_4)
line_length = Number(len_2)
area_4 = Number(area_3)
entwine_2 = Entwine(Branch00=line_length, Branch01=area_4, Branch02=geo_9, Branch03=line_4, FlattenInputs=True)
flip_6 = FlipMatrix(Data=entwine_2)  # -> simplify(Data)

line_5 = Line(cluster_2.center_line_2)
geo_10 = Geometry(geo_8)
area_5 = Number(area_2.Area)
len_3 = Length(Curve=line_5)
line_length_2 = Number(len_3)
area_6 = Number(area_5)
entwine_3 = Entwine(Branch00=line_length_2, Branch01=area_6, Branch02=geo_10, Branch03=line_5, FlattenInputs=True)
flip_7 = FlipMatrix(Data=entwine_3)  # -> simplify(Data)

# ---- group: Core of the script
demand_tree = Data(flip_6)
supply_tree = Data(flip_7)
python = GhPythonScript(demand=demand_tree, supply=supply_tree)  # -> out, mapping_id, cut_length, temp; inputs demand: tree, supply: tree
# ---------- python: Python ----------
"""Provides a scripting component.
    Inputs:
        demand: testsetste
        y: The y script variable
    Output:
        a: The a output variable"""

__author__ = "arturbt"
__version__ = "2022.07.26"

import rhinoscriptsyntax as rs
import ghpythonlib.treehelpers as th
import Rhino

""" METHODS """ 

def tree2lol(input_tree):
    # https://developer.rhino3d.com/guides/rhinopython/grasshopper-datatrees-and-python/    lol = []
    lol=[]
    for i in range(input_tree.BranchCount):
        sublist = []
        branchPath = input_tree.Path(i)
        branchList = input_tree.Branch(i)
        for j in range(branchList.Count):
            sublist.append(branchList[j])
        lol.append(sublist)
    return lol

def lol2tree(input_lol):
    # https://developer.rhino3d.com/guides/rhinopython/grasshopper-datatrees-and-python/
    tree = th.list_to_tree(input_lol, source=[0,0])
    return tree

""" INPUT """ 

# turn to list of lists and sort by length
demand_list = sorted(tree2lol(demand), key=lambda x: x[0]) 
supply_list = sorted(tree2lol(supply), key=lambda x: x[0])

# add original index (branch path) because later we delete  some
[demand_list[i].append(i) for i in range(len(demand_list))]
[supply_list[i].append(i) for i in range(len(supply_list))]


""" CALCULATION """ 

mapping_id = []
cut_length = []
temp = []

for i in range(len(demand_list)):
    match=False
    for j in range(len(supply_list)):
        if demand_list[i][0] <= supply_list[j][0] and demand_list[i][1] <= supply_list[j][1]:
            match=True
            mapping_id.append(supply_list[j][-1])
            cut_length.append(supply_list[j][0] - demand_list[i][0])
            temp.append(supply_list[j])
            break
    if match:
        del supply_list[j]
    else:
        mapping_id.append(None)
        cut_length.append(None)

""" OUTPUT """

mapping_id = lol2tree(mapping_id)
temp = lol2tree(temp)
# ---------- end python ----------

# ----
# TODO: make universal grouping python:
# - group by minimum element (not average)
# - use multidimensional distance formula
series_2 = Series(Start=0, Step=50, Count=10)
pt_10 = ConstructPoint(XCoordinate=0, YCoordinate=0, ZCoordinate=series_2)
pt2num = PointsToNumbers(Points=graft(pt_10), Mask=4)  # -> simplify(Numbers)
series_3 = Series(Start=0, Step=250, Count=10)
pt_11 = ConstructPoint(XCoordinate=0, YCoordinate=0, ZCoordinate=series_3)
py_group_by = GhPythonScript(input=simplify(pt2num), tolerance=Slider(2, range=1..10))  # -> out, simplify(groups), mapping_id, group_min; inputs input: tree
# ---------- py_group_by: Python ----------
__author__ = "arturbt"
__version__ = "2022.08.02"

import rhinoscriptsyntax as rs
import ghpythonlib.treehelpers as th
import Rhino


groups_list = []


def tree2lol(input_tree):
    # https://developer.rhino3d.com/guides/rhinopython/grasshopper-datatrees-and-python/    lol = []
    lol=[]
    for i in range(input_tree.BranchCount):
        sublist = []
        branchPath = input_tree.Path(i)
        branchList = input_tree.Branch(i)
        for j in range(branchList.Count):
            sublist.append(branchList[j])
        lol.append(sublist)
    return lol

input = tree2lol(input)



# TODO Normalise input



# calculate multi-dimensional distance
# sqrt( (x2-x1)**2 + (y2-y1)**2 + (z2-z1)**2 ) 
for i in input:
    d = ((i[0]-0)**2+(i[1]-0)**2+(i[2]-0)**2)**(0.5)
    groups_list.append(d)


# Turn to Grasshopper tree
# https://developer.rhino3d.com/guides/rhinopython/grasshopper-datatrees-and-python/
groups = th.list_to_tree(groups_list, source=[0,0])
# ---------- end py_group_by ----------
panel_7 = Panel(pt2num)
pgroups = PointGroups(Points=pt_11, Distance=Slider(250, range=0..300))  # -> simplify(Groups), Indices
panel_8 = Panel(py_group_by.groups)
panel_9 = Panel(pgroups.Groups)

# ---- group: Calculate cut length
cut_length = Number(python.cut_length)
null = NullItem(Item=cut_length)  # -> NullFlags, InvalidFlags, Description
dispatch = Dispatch(List=cut_length, DispatchPattern=null.NullFlags)  # -> ListA, ListB
ma = MassAddition(Input=dispatch.ListB)  # -> Result, PartialResults
division = Division(A=ma.Result, B=1000)
total_cut_length_m = Panel(division)

# ---- group: Actual mapping
number_slider_2 = Slider(97, range=0..300)
pt_12 = Point(pt_8)
pt_13 = Point(pt_9)
pgroups_2 = PointGroups(Points=pt_12, Distance=number_slider_2)  # -> simplify(Groups), Indices
division_2 = Division(A=number_slider_2, B=2)
avr = Average(Input=pgroups_2.Groups)  # -> flatten(ArithmeticMean)
lng_3 = ListLength(List=pgroups_2.Indices)  # -> flatten(Length)
cps = ClosestPoints(Point=avr, Cloud=pt_13, Count=lng_3)  # -> ClosestPoint, CPIndex, Distance

# ---- group: Display groups
item_2 = ListItem(List=geo_7, Index=pgroups_2.Indices, Wrap=True)  # -> simplify(Item)
tstat = TreeStatistics(Tree=item_2)  # -> Paths, Length, Count
division_3 = Division(A=1, B=tstat.Count)
series_4 = Series(Start=0, Step=division_3, Count=tstat.Count)
hsl = ColourHSL(Alpha=1, Hue=series_4, Saturation=1, Luminance=0.5)
preview = CustomPreview(Geometry=item_2, Material=graft(hsl))

# ----
ln_3 = Line(StartPoint=graft(avr), EndPoint=cps.ClosestPoint)
sph = Sphere(Base=avr, Radius=division_2)
sph_2 = Sphere(Base=cps.ClosestPoint, Radius=15)

# ---- group: Get matched elements
mapping_index = Number(python.mapping_id)
# Visualization of results
demand_geo = Geometry(geo_7)
supply_geo = Geometry(geo_8)
null_2 = NullItem(Item=mapping_index)  # -> NullFlags, InvalidFlags, Description
dispatch_2 = Dispatch(List=mapping_index, DispatchPattern=null_2.NullFlags)  # -> ListA, ListB
dispatch_3 = Dispatch(List=demand_geo, DispatchPattern=null_2.NullFlags)  # -> ListA, ListB
unmatched_demand = Data(dispatch_3.ListA)
matched_demand = Data(dispatch_3.ListB)

# ----
cull_i_2 = CullIndex(List=supply_geo, Indices=dispatch_2.ListB, Wrap=True)
item_3 = ListItem(List=supply_geo, Index=dispatch_2.ListB, Wrap=True)
unmatched_supply = Data(cull_i_2)

# ---- group: Get matched elements (continued)
matching_supply = Data(item_3)

# ---- group: Display results
curvepoint = PointOnCurve(parameter=0.5)
curvepoint_2 = PointOnCurve(parameter=0.5)
ln_4 = Line(StartPoint=curvepoint_2, EndPoint=curvepoint)
preview_2 = CustomPreview(Geometry=ln_4, Material=ColourSwatch(SwatchColor=RGB(230, 182, 101)))
preview_3 = CustomPreview(Geometry=unmatched_demand, Material=ColourSwatch(SwatchColor=RGB(168, 32, 32)))
preview_4 = CustomPreview(Geometry=matched_demand, Material=ColourSwatch(SwatchColor=RGB(80, 166, 46)))
preview_5 = CustomPreview(Geometry=matching_supply, Material=ColourSwatch(SwatchColor=RGB(101, 200, 230)))

# ----
preview_6 = CustomPreview(Geometry=unmatched_supply, Material=ColourSwatch(SwatchColor=RGB(168, 32, 32)))

# ==== cluster Cluster
init_numbers = ClusterInput()
init_numbers_2 = Number(init_numbers)
sort = SortList(Keys=init_numbers_2)  # -> Keys, ValuesA
target_max = ClusterInput()
item = ListItem(List=sort.Keys, Index=-1, Wrap=True)
dom = ConstructDomain(DomainStart="0", DomainEnd=target_max)
dom_2 = ConstructDomain(DomainStart="0", DomainEnd=item)
remap = RemapNumbers(Value=init_numbers_2, Source=dom_2, Target=dom)  # -> RemappedNumbers, Clipped
remapped_numbers = ClusterOutput(remap.RemappedNumbers)

# ==== cluster Cluster_2
geo = ClusterInput()

# ---- group: Take longest edge
geo_2 = Geometry(geo)
debrep = DeconstructBrep(Brep=geo_2)  # -> Faces, Edges, Vertices
len = Length(Curve=debrep.Edges)
lng = ListLength(List=len)
series = Series(Start=0, Step=1, Count=lng)
sort = SortList(Keys=len, ValuesA=series)  # -> Keys, ValuesA
item = ListItem(List=sort.ValuesA, Index=-1, Wrap=True)
item_2 = ListItem(List=debrep.Edges, Index=item, Wrap=True)
line = Line(flatten(item_2))
geo_3 = Geometry(geo_2)

# ---- group: Get profile and bbox
line_2 = Line(line)
geo_4 = Geometry(geo_3)
curvepoint = PointOnCurve(line_2, parameter=0.5)
vec = Vector(line_2)
pl = PlaneNormal(Origin=curvepoint, ZAxis=vec)
mesh = Mesh(geo_4)
bbox = BoundingBox(Content=graft(geo_4), Plane=graft(pl), UnionBox=False)  # -> flatten(Box), flatten(Box_2)
sec = MeshPlane(Mesh=mesh, Plane=pl)
boundary = BoundarySurfaces(Edges=sec)
profile_boundary_crv = Curve(flatten(sec))
geometry_bbox = Box(bbox.Box)
profile_srf = Surface(flatten(boundary))

# ----
boxprop = BoxProperties(Box=geometry_bbox)  # -> Centroid, Diagonal, Area, BoxVolume, Degeneracy

# ---- group: Take longest edge
geo_5 = Geometry(geometry_bbox)
debrep_2 = DeconstructBrep(Brep=geo_5)  # -> Faces, Edges, Vertices
len_2 = Length(Curve=debrep_2.Edges)
lng_2 = ListLength(List=len_2)
series_2 = Series(Start=0, Step=1, Count=lng_2)
sort_2 = SortList(Keys=len_2, ValuesA=series_2)  # -> Keys, ValuesA
item_3 = ListItem(List=sort_2.ValuesA, Index=-1, Wrap=True)
item_4 = ListItem(List=debrep_2.Edges, Index=item_3, Wrap=True)
line_3 = Line(flatten(item_4))

# ----
profile_srf_2 = ClusterOutput(profile_srf)
profile_boundary_crv_2 = ClusterOutput(profile_boundary_crv)
geometry_bbox_2 = ClusterOutput(geometry_bbox)
centroid = ClusterOutput(boxprop.Centroid)
box_volume = ClusterOutput(boxprop.BoxVolume)

# ---- group: Locate centerline and get area
profile_srf_3 = Surface(profile_srf)
line_4 = Line(line_3)
area = Area(Geometry=profile_srf_3)  # -> Area, Centroid
crv_cp = CurveClosestPoint(Point=area.Centroid, Curve=line_4)  # -> Point, Parameter, Distance
vec2pt = Vector2Pt(PointA=crv_cp.Point, PointB=area.Centroid, Unitize=False)  # -> Vector, Length
move = Move(Geometry=line_4, Motion=vec2pt.Vector)  # -> Geometry, Transform
center_line = Line(move.Geometry)

# ----
center_line_2 = ClusterOutput(center_line)
